# Grasshopper definition DeepSight_Examples.gh (Grasshopper 1.0.8)
# plug-ins: DeepSight.GH

number_slider = Slider(0.1, range=0..0.1)
vgridcreate = VGridCreate(Name="default")
gridcreate = GridCreate(Name="default")
mesh = Mesh(<mesh referenced from the Rhino model>)
curve = Curve(<curve referenced from the Rhino model>)
mesh2grid = Mesh2Grid(
    Mesh=mesh,
    Isovalue=0,
    VoxelSize=Slider(0.1, range=0..1),
    ExteriorBandwidth=Slider(2, range=0..10),
    InteriorBandwidth=Slider(0.4, range=0..1),
    Name="default")
pointcloud2grid = PointCloud2Grid(VoxelSize=1, Name="default")  # -> Debug, Grid
curve2grid = Curve2Grid(Curve=curve, Thickness=Slider(0.4, range=0..1), VoxelSize=Slider(0.25, range=0..1), Name="default")
grid2mesh = Grid2Mesh(Grid=gridcreate, Isovalue=0.15)
griddisplay = GridDisplay(Grid=curve2grid, Threshold=0.15, Update=False)
griddisplay_2 = GridDisplay(Grid=mesh2grid, Threshold=0.15, Update=False)
