# Grasshopper definition 20201026_images_to_curves.gh (Grasshopper 1.0.7)
# plug-ins: MeshEdit Components, Human

# ---- group: read text file
path = FilePath("C:\Users\sgat\Desktop\03_data\zebicon-ccc195\cropped_jpeg\img_to_crv.txt")
file = ReadFile(File=path, PerLineParse=True)
split = TextSplit(Text=file, Separators=" ")
item = ListItem(List=split, Index=0, Wrap=True)  # -> flatten(Item), flatten(Item1), flatten(Item2), flatten(Item3)
cset = CreateSet(List=item.Item)  # -> Set, Map
pt = ConstructPoint(XCoordinate=item.Item1, YCoordinate=item.Item2, ZCoordinate=item.Item)
mindex = MemberIndex(Set=item.Item, Member=cset.Set)  # -> simplify(Index), Count
circle = CircleCNR(Center=pt, Normal=Vector(0, 0, 1), Radius=item.Item3)
unflatten = UnflattenTree(Tree=circle, Guide=mindex.Index)
unflatten_2 = UnflattenTree(Tree=pt, Guide=mindex.Index)

# ---- group: create series for branches
lng = ListLength(List=unflatten)  # -> flatten(Length)
lng_2 = ListLength(List=lng)
subtraction = Subtraction(A=lng_2, B=1)
series = Series(Start=0, Step=1, Count=subtraction)
addition = Addition(A=series, B=1)

# ---- group: tree mapping
branch = TreeBranch(Tree=unflatten_2, Path=addition, MaintainPaths=True)
branch_2 = TreeBranch(Tree=unflatten_2, Path=series, MaintainPaths=True)
branch_3 = TreeBranch(Tree=unflatten, Path=addition, MaintainPaths=True)
branch_4 = TreeBranch(Tree=unflatten, Path=series, MaintainPaths=True)
cp = ClosestPoint(Point=branch_2, Cloud=branch)  # -> ClosestPoint, CPIndex, Distance
item_2 = ListItem(List=branch_3, Index=cp.CPIndex, Wrap=True)
ln = Line(StartPoint=branch_2, EndPoint=cp.ClosestPoint)  # -> flatten(Line)

# ---- group: curves
join = JoinCurves(Curves=ln, Preserve=False)

# ---- group: grid box
group = Group(Objects=circle)
bbox = BoundingBox(Content=group, Plane=PlaneXY(0, 0, 0))  # -> Box, Box_2
edges = BrepEdges(Brep=bbox.Box)  # -> Naked, Interior, NonManifold
previewlw = CustomPreviewLineweights(
    Geometry=edges.Interior,
    Shader=ColourSwatch(SwatchColor=RGB(255, 255, 255)),
    Thickness=Slider(2, range=0..10),
    Absolute=False)

# ---- group: color surface
rulesrf = RuledSurface(CurveA=branch_4, CurveB=item_2)  # -> flatten(Surface)
area = MeshArea(Mesh=rulesrf)  # -> Area, Centroid
cps = ClosestPoints(Point=area.Centroid, Cloud=area.Centroid, Count=2)  # -> ClosestPoint, CPIndex, Distance
item_3 = ListItem(List=cps.Distance, Index=0, Wrap=True)  # -> Item, flatten(Item1)
bnd = Bounds(Numbers=item_3.Item1)
bnd_2 = Bounds(Numbers=area.Area)
remap = RemapNumbers(Value=item_3.Item1, Source=bnd, Target=Domain(0, 1))  # -> Mapped, Clipped
remap_2 = RemapNumbers(Value=area.Area, Source=bnd_2, Target=Domain(0, 1))  # -> Mapped, Clipped

# ---- group: color surface / distance
gradient = Gradient(LowerLimit=0, UpperLimit=1, Parameter=remap.Mapped, stops=[0: RGB(0, 128, 0), 0.5: RGB(255, 255, 0), 1: RGB(255, 0, 0)])

# ---- group: color surface / area
gradient_2 = Gradient(
    LowerLimit=0,
    UpperLimit=1,
    Parameter=remap_2.Mapped,
    stops=[0: RGB(0, 128, 0), 0.5: RGB(255, 255, 0), 1: RGB(255, 0, 0)])

# ---- group: volume
dam = DataDam(DataA=rulesrf, BufferDelay=10000000, BufferMode=0)
cap = CapHoles(Brep=dam)
volume = MeshVolume(Mesh=bbox.Box)  # -> Volume, Centroid
volume_2 = MeshVolume(Mesh=cap)  # -> Volume, Centroid
ma = MassAddition(Input=volume_2.Volume)  # -> Result, PartialResults
remap_3 = RemapNumbers(Value=ma.Result, Source=volume.Volume, Target=Domain(0, 100))  # -> Mapped, Clipped
procentage_of_straws = Panel(remap_3.Mapped)

# ---- group: color surface (continued)
preview = CustomPreview(Geometry=rulesrf, Material=gradient_2)
